# Grasshopper definition postgres_curobo for bridge component.gh (Grasshopper 1.0.7)
# plug-ins: MouseSelection, RemoSharp, Robots, CuroboPathPlanner, Collaborative Geometry, Machina

hold_button_for_test = Button()

select_config = Slider(16, range=0..32)

submit_stick_s = Button()
reset_selection = Button()
trigger = Trigger(Interval=100, TimerInterval=100, Target=previewdesign)
from_home = BooleanToggle(True)
visualize = BooleanToggle(False)
trigger_2 = Trigger(Interval=100, TimerInterval=100, Target=c_script_3)
or = GateOr(A=reset_selection, B=Button())
toggle = BooleanToggle(True)
panel = Panel("1.1320000000000001, 0.9460000000000001, 0.6")
hp = HomePose("0.0,-1.5708,1.5708,0.0,1.5708,0.0")

rg6_tcp = OnRobotRG6_TCP()
pdecon = Deconstruct(Point=rg6_tcp)  # -> XComponent, YComponent, ZComponent

split = TextSplit(Text=hp, Separators=",")
number_slider = Slider(473, range=0..1000)
number_slider_2 = Slider(300, range=0..1000)
xy = XYPlane(Origin=Point(0, 0, 0))
rotpl = RotatePlane(plane=xy, X=0, Y=0, Z=Slider(180, range=0..1000), flip=False, glb=False)
neg = Negative(Value=number_slider)
neg_2 = Negative(Value=number_slider_2)
dom = ConstructDomain(DomainStart=neg, DomainEnd=number_slider)
dom_2 = ConstructDomain(DomainStart=neg_2, DomainEnd=number_slider_2)

number_slider_3 = Slider(566, range=0..1000)
neg_3 = Negative(Value=number_slider_3)
dom_3 = ConstructDomain(DomainStart=neg_3, DomainEnd=number_slider_3)
pt = Point(Point(0, 0, -300))
box = DomainBox(Base=pt, X=dom_3, Y=dom, Z=dom_2)
c_script = CSharpScript(x=box, pnt=pt)  # -> out, A, B, C, D; inputs x: Box, pnt: Point3d, name: String
# ---------- c_script: C# ----------
    D = x.Center;
    x.Transform(Transform.Scale(Point3d.Origin, 0.001));
    pnt *= 0.001;

    var pl = Plane.WorldXY;
    //    pl.Flip();

    Quaternion q = Quaternion.Rotation(Plane.WorldXY, pl);

    List<double> pose = new List<double>();
    pose.Add(x.Center.X);
    pose.Add(x.Center.Y);
    pose.Add(x.Center.Z);
    pose.Add(q.A);
    pose.Add(q.B);
    pose.Add(q.C);
    pose.Add(q.D);

    List<double> dim = new List<double>();
    dim.Add(x.X.Length);
    dim.Add(x.Y.Length);
    dim.Add(x.Z.Length);

    var pvt = this.Component.Attributes.Pivot;
    A = string.Format("obj_at_{0}_{1}",pvt.X,pvt.Y);
    B = pose;
    C = dim;
# ---------- end c_script ----------
preview = CustomPreview(Geometry=box, Material=ColourSwatch(SwatchColor=RGB(164, 214, 161)))
obstacles = ObstaclesComponent(Name=c_script.A, Pose=c_script.B, Dims=c_script.C)

viz = BooleanToggle(False)
list = RobotsLibrary({"UR3e", "UR5e", "UR10e", "UR16e", "UR3", "UR5", "UR10", "UR20", "UR30"}, selected="UR10e", Type=0)
panel_2 = Panel("https://robocall.arastookhajehee.net")
panel_3 = Panel(",")
c_script_2 = CSharpScript(x=list)  # -> out, A; inputs x: String
# ---------- c_script_2: C# ----------
    A = x.ToLower() + ".yml";
# ---------- end c_script_2 ----------
loadrobot = LoadRobotSystem(Name=list, Base=rotpl)
merge = Merge(Data2=obstacles)

mesh = Mesh(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)
tool = CreateTool(Name="DefaultGHTool", TCP=PlaneXY(0, 0, 0), Weight=0, Mesh=mesh)  # -> Tool, TCP

flatten = FlattenTree(Tree=merge, Path="{0}")
reset = Button()
trigger_3 = Trigger(Interval=100, TimerInterval=100, Target=c_script_6)
target = CreateTarget(Joints=hp, Tool=tool.Tool, IsCartesian=False)
program = CreateProgram(Name="DefaultProgram", RobotSystem=loadrobot, Targets=target, StepSize=1)  # -> Program, Code, Duration, Warnings, Errors
sim = ProgramSimulation(Program=program.Program, Time=Slider(1, range=0..1), Normalized=True)  # -> SystemMeshes, JointRotations, Plane, Index, Time, Program, Errors

# ----
# CUSTOM STICKS
panel_4 = Panel("C:\Users\akhaj\source\repos\CollaborativeGeometryServer\local_db\local_db.json")
file = ReadFile(File=panel_4, PerLineParse=False)
xy_2 = XYPlane(Origin=Point(0, 0, 0))
button = Button()
rtf = ReadTreeFile(Json=file, ResetPlane=xy_2, ResetZShift=0, RESET=button)  # -> BonsaiTree, Json, Breps, Colors
writetofile = WriteToFile(Write=button, TxtContent=rtf.Json, FilePath=panel_4)
xy_3 = XYPlane(Origin="1000,0,-600")
addcustom = Button()
python = GhPythonScript(tree=rtf.BonsaiTree, user="base", color=ColourSwatch(SwatchColor=RGB(224, 195, 114)), planes=xy_3)  # -> out, a; inputs tree: list, color: Color, planes: list
# ---------- python: Python ----------
import Rhino
import clr

# Add reference to System.Drawing for the Color type
clr.AddReference("System.Drawing")
from System.Drawing import Color
import System

# Assuming you have access to the instance of TimberBranch
#tree = # assuming 'tree' is an existing TimberBranch instance
obj_type = tree[0].GetType()  # Get the type from an existing instance

def construct(placementPlane, user, color, obj_type):
    # Prepare the  for the constructor
    
    state = "virtual"
    # Get the constructor with the specific parameter types
    constructor_info = obj_type.GetConstructor(System.Array[System.Type]([
        Rhino.Geometry.Plane,  # Parameter type for placementPlane
        System.String,         # Parameter type for user
        Color,                 # Parameter type for color
        System.String          # Parameter type for state
    ]))
    
    # Check if the constructor is found and invoke it
    if constructor_info:
        return constructor_info.Invoke(System.Array[object]([placementPlane, user, color, state]))
#        print("Object created:", new_obj)
    else:
        return None

for pl in planes:
    obj = construct(pl, user, color, obj_type)
    
    tree.append(obj)
    

a = tree[-1]
# ---------- end python ----------

confirm_bridge_compute = BooleanToggle(False)
connect_websocket = BooleanToggle(False)
mouse_interactions = BooleanToggle(False)
submit_stick_s_2 = Button()
user_color = ColourSwatch(SwatchColor=RGB(122, 246, 255))
username = Panel("username")

or_2 = GateOr(A=hold_button_for_test, B=confirm_bridge_compute)
nickname = PoolConnection(Url="wss://cu-test-251026.arastookhajehee.net", Connect=connect_websocket, IsWSSServer=Toggle(True))
or_3 = GateOr(A=submit_stick_s_2, B=submit_stick_s)
previewdesign = PreviewDesign(Ws=nickname, TextScale=Slider(1, range=0..1), Transparency=Slider(150, range=0..1000), Offset=Slider(3, range=0..10))  # -> Pt, User, Box, Color
c_script_3 = CSharpScript(z=reset_selection, x=or_3, y=confirm_bridge_compute)  # -> out, A, B; inputs x: Boolean
# ---------- c_script_3: C# usings ----------
using System.Threading.Tasks;
# ---------- c_script_3: C# ----------
    counter++;

    if (x) counter = 0;

    if (counter == 3)
    {
      this.GrasshopperDocument.ScheduleSolution(1, doc => {

        Grasshopper.Kernel.Special.GH_ButtonObject button =
          (Grasshopper.Kernel.Special.GH_ButtonObject) this.Component.Params.Input[0].Sources[0];
        button.ButtonDown = true;
        button.ExpireSolution(true);
        
        Grasshopper.Kernel.Special.GH_BooleanToggle toggle = 
          (Grasshopper.Kernel.Special.GH_BooleanToggle) this.Component.Params.Input[2].Sources[0];
        toggle.Value = false;
        toggle.ExpireSolution(true);
        
        });
    }
    else if (counter == 6)
    {
      this.GrasshopperDocument.ScheduleSolution(1, doc => {

        Grasshopper.Kernel.Special.GH_ButtonObject button =
          (Grasshopper.Kernel.Special.GH_ButtonObject) this.Component.Params.Input[0].Sources[0];
        button.ButtonDown = false;
        button.ExpireSolution(true);
        });
    }
# ---------- c_script_3: C# additional code ----------
  int counter = 10;
# ---------- end c_script_3 ----------
wires = BrepWireframe(Brep=previewdesign.Box, Density=Slider(4, range=0..10))
nickname_2 = PoolTree(Ws=nickname)
tag = TextTag(Location=previewdesign.Pt, Text=previewdesign.User, Colour=previewdesign.Color)
panel_5 = Panel(previewdesign.Pt)
preview_2 = CustomPreview(Geometry=wires, Material=previewdesign.Color)
mouseselection = MouseSelection(Run=mouse_interactions, Branches=nickname, Reset=or, ModifyMode=Toggle(False))  # -> SelectedBranch, SecondaryBranch
detbranch = DeconstructTBranch(TBranch=nickname_2)  # -> Branch_id, Placement_plane, Orientable_planes, Borders, User_name, Color, Status, Parents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
singlet = SingleTrueFilter(Trigger=nickname_2, Boolean=or_3)

singlet_2 = SingleTrueFilter(Trigger=nickname_2, Boolean=addcustom)
nickname_3 = SubmitSingleBranch(Ws=nickname, Branch=python.a, Submit=singlet_2, Override=False)

clean = CleanTree(
    RemoveNulls=True,
    RemoveInvalid=True,
    RemoveEmpty=False,
    Tree=[mouseselection.SelectedBranch, mouseselection.SecondaryBranch])
preview_3 = CustomPreview(Geometry=detbranch.Brep, Material=detbranch.Color)
lng = ListLength(List=clean)
equals = Equality(FirstNumber="1", SecondNumber=lng)  # -> Equality, Inequality
item = ListItem(List=clean, Index=0, Wrap=True)  # -> Item, Item1
lng_2 = ListLength(List=clean)
addtbranch = AddTBranch(
    Ws=nickname,
    Selection=mouseselection.SelectedBranch,
    User_name=username,
    Color=user_color,
    ADD=False,
    MouseClicks=equals.Equality)  # -> Preivew, Circle, Serliazed, TBranch
equals_2 = Equality(FirstNumber="2", SecondNumber=lng_2)  # -> Equality, Inequality
detbranch_2 = DeconstructTBranch(TBranch=addtbranch.TBranch)  # -> Branch_id, Placement_plane, Orientable_planes, Borders, User_name, Color, Status, Parents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
computebridge = ComputeBridge(
    Run=equals_2.Equality,
    Shift_a=Slider(-0.032, range=-0.45..0.45),
    Shift_b=Slider(-0.027, range=-0.45..0.45),
    Shift_ab=Slider(1.569, range=-3.5..3.5),
    Branch_a=item.Item,
    Branch_b=item.Item1)

neg_4 = Negative(Value=pdecon.ZComponent)
subtraction = Subtraction(A=neg_4, B=Slider(0, range=0..100))
deplane = DeconstructPlane(Plane=detbranch_2.Orientable_planes)  # -> Origin, XAxis, YAxis, ZAxis
amp = Amplitude(Vector=deplane.ZAxis, Amplitude=subtraction)
move = Move(Geometry=detbranch_2.Orientable_planes, Motion=amp)  # -> Geometry, Transform

branch = TreeBranch(Tree=computebridge, Path=select_config, MaintainPaths=True)
merge_2 = Merge(Data1=addtbranch.TBranch, Data2=branch)  # -> flatten(Result)
clean_2 = CleanTree(RemoveNulls=True, RemoveInvalid=True, RemoveEmpty=False, Tree=merge_2)
clean_3 = CleanTree(RemoveNulls=True, RemoveInvalid=True, RemoveEmpty=Toggle(True), Tree=computebridge)
python_2 = GhPythonScript(x=branch)  # -> a, b; inputs x: list
# ---------- python_2: Python ----------
__author__ = "akhaj"
__version__ = "2025.09.02"

import rhinoscriptsyntax as rs

a = x[0].placement_plane
b = x[1].placement_plane
# ---------- end python_2 ----------
detbranch_3 = DeconstructTBranch(TBranch=clean_2)  # -> Branch_id, Placement_plane, Orientable_planes, Borders, User_name, Color, Status, Parents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
c_script_4 = CSharpScript(x=clean_3)  # -> out, A; inputs x: tree
# ---------- c_script_4: C# ----------
    A = string.Format("[{0}]", string.Join(",",x.Paths));
# ---------- end c_script_4 ----------
txt = Text(c_script_4.A)

possible_bridge_configurations = Panel(txt)

bridge = GenrateBridge(
    Branches=nickname,
    Plane1=python_2.a,
    Plane2=python_2.b,
    Selection1=item.Item,
    Selection2=item.Item1,
    User_name=username,
    Color=user_color,
    ADD=Toggle(False))  # -> Preivew, Serliazed, TBranch
nickname_4 = SubmitPreview(Ws=nickname, User=username, Color=user_color, Selecitons=clean, PreviewPlanes=detbranch_3.Placement_plane)
clean_4 = CleanTree(RemoveNulls=True, RemoveInvalid=True, RemoveEmpty=False, Tree=bridge.TBranch)
ptp = PlaneToPose(Plane=move.Geometry, Scale="0.001")  # -> Origin, Quaternion, Pose
curobocallbridge = CuroboCallBridge(
    Request=or_2,
    URL=panel_2,
    HomePosition=hp,
    Visualize=visualize,
    ToolOffset=subtraction,
    PreviewSticks=clean_4,
    ParentSticks=clean)  # -> Success, Response, Poses_1, Poses_2, Order
clean_5 = CleanTree(RemoveNulls=True, RemoveInvalid=True, RemoveEmpty=False, Tree=addtbranch.TBranch)
cbcall = CuroboCall(
    URL=panel_2,
    Robot=c_script_2.A,
    Targets=ptp.Pose,
    Obstacles=flatten,
    Stick=clean_5,
    FromHome=from_home,
    HomePose=hp,
    Visualize=visualize)  # -> OK, Error, Poses
panel_6 = Panel(curobocallbridge.Order)
python_3 = GhPythonScript(x=curobocallbridge.Poses_1, y=curobocallbridge.Poses_2, z=curobocallbridge.Order)  # -> out, a; inputs x: list, y: list
# ---------- python_3: Python ----------
__author__ = "akhaj"
__version__ = "2025.10.24"

import rhinoscriptsyntax as rs


sim_list = []

if z == 1:
    sim_list.extend(x)
    sim_list.extend(y)
elif z == 2:
    sim_list.extend(y)
    sim_list.extend(x)

a = sim_list
# ---------- end python_3 ----------
panel_7 = Panel([cbcall.OK, cbcall.Error])
merge_3 = Merge(Data1=cbcall.Poses, Data2=python_3.a)  # -> flatten(Result)
concat = Concatenate(FragmentA=cbcall.Error, FragmentB=curobocallbridge.Response)
panel_8 = Panel(concat)
clean_6 = CleanTree(RemoveNulls=True, RemoveInvalid=True, RemoveEmpty=False, Tree=merge_3)
target_2 = CreateTarget(Joints=clean_6, Tool=tool.Tool, IsCartesian=False)
flatten_2 = FlattenTree(Tree=clean_6, Path="{0}")
flatten_3 = FlattenTree(Tree=target_2, Path="{0}")
c_script_5 = CSharpScript(result=concat, color=user_color, trs=Slider(150, range=0..255), robot=ColourSwatch(SwatchColor=RGB(151, 201, 190)))  # -> out, A, B, C, D; inputs result: String, color: Color, trs: Int32, robot: Color
# ---------- c_script_5: C# ----------
    var defCol = System.Drawing.Color.Gray;

    switch (result)
    {
      case ("environment_collision"):
        A = System.Drawing.Color.Red;
        B = color;
        C = robot;
        D = System.Drawing.Color.FromArgb(100, defCol.R, defCol.G, defCol.B);
        return;
      case ("floating"):
        var gray = System.Drawing.Color.DarkGray;
        A = System.Drawing.Color.FromArgb(255, gray.R, gray.G, gray.B);
        B = color;
        C = robot;
        D = System.Drawing.Color.FromArgb(100, defCol.R, defCol.G, defCol.B);
        return;
      case ("unreachable"):
        var orange = System.Drawing.Color.Orange;
        A = System.Drawing.Color.FromArgb(trs, orange.R, orange.G, orange.B);
        B = color;
        C = orange;
        D = System.Drawing.Color.FromArgb(100, defCol.R, defCol.G, defCol.B);
        return;
      default:
        A = System.Drawing.Color.FromArgb(trs, color.R, color.G, color.B);
        B = color;
        C = robot;
        D = System.Drawing.Color.FromArgb(100, defCol.R, defCol.G, defCol.B);
        return;
    }
# ---------- end c_script_5 ----------
item_2 = ListItem(List=flatten_2, Index=0, Wrap=True)  # -> Item1, Item
merge_4 = Merge(Data1=addtbranch.Preivew, Data2=bridge.Preivew)
lng_3 = ListLength(List=flatten_3)
c_script_6 = CSharpScript(max=lng_3, pnt=item_2.Item1, rst=reset, speed=Slider(10, range=0..30))  # -> out, A; inputs max: Int32, pnt: String, rst: Boolean, speed: Int32
# ---------- c_script_6: C# ----------
    i+= speed;
    if (i > max - 1)
    {
      i = max - 1;
    }
    if (cpt != pnt || rst)
    {
      i = 0;
      cpt = pnt;
    }
    A = i;
# ---------- c_script_6: C# additional code ----------
  int i = 0;
  string cpt = "";
# ---------- end c_script_6 ----------
item_3 = ListItem(List=flatten_3, Index=c_script_6.A, Wrap=True)
submit = SubmitAddTbranch(Ws=nickname, Branch=clean_5, Robot_path=clean_6, Result=cbcall.OK, Override=False, Submit=singlet)
nickname_5 = SubmitAddBridge(
    Ws=nickname,
    Branch=clean_4,
    Robot_path_1=curobocallbridge.Poses_1,
    Robot_path_2=curobocallbridge.Poses_2,
    Order=curobocallbridge.Order,
    Result=curobocallbridge.Success,
    Override=False,
    Submit=singlet)
preview_4 = CustomPreview(Geometry=merge_4, Material=c_script_5.A)
preview_5 = CustomPreview(Geometry=addtbranch.Circle, Material=c_script_5.B)
panel_9 = Panel(cbcall.Poses)
clean_7 = CleanTree(RemoveNulls=True, RemoveInvalid=True, RemoveEmpty=False, Tree=item_3)
program_2 = CreateProgram(Name="DefaultProgram", RobotSystem=loadrobot, Targets=clean_7, StepSize=1)  # -> Program, Code, Duration, Warnings, Errors
lng_4 = ListLength(List=flatten_3)
sim_2 = ProgramSimulation(Program=program_2.Program, Time=Slider(1, range=0..1), Normalized=True)  # -> SystemMeshes, JointRotations, Plane, Index, Time, Program, Errors
item_4 = ListItem(List=sim_2.Plane, Index=0, Wrap=True)  # -> Item1, Item
preview_6 = CustomPreview(Geometry=sim.SystemMeshes, Material=c_script_5.D)
preview_7 = CustomPreview(Geometry=sim_2.SystemMeshes, Material=c_script_5.C)
pln = Plane(item_4.Item1)
panel_10 = Panel(cbcall.Error)
