# Grasshopper definition postgres_curobo.gh (Grasshopper 1.0.7)
# plug-ins: MouseSelection, RemoSharp, Robots, CuroboPathPlanner, Collaborative Geometry, Machina

connect = BooleanToggle(True)

config = Slider(0, range=0..10)

reset_selection = Button()
from_home = BooleanToggle(True)
visualize = BooleanToggle(False)
submit = Button()
nickname = PoolConnection(Url="ws://172.21.0.1:8080", Connect=connect)
trigger = Trigger(Interval=100, TimerInterval=100, Target=previewdesign)
previewdesign = PreviewDesign(Ws=nickname, TextScale=Slider(1, range=0..1), Transparency=Slider(150, range=0..1000), Offset=Slider(3, range=0..10))  # -> Pt, User, Box, Color
trigger_2 = Trigger(Interval=100, TimerInterval=100, Target=c_script)
wires = BrepWireframe(Brep=previewdesign.Box, Density=Slider(4, range=0..10))
nickname_2 = PoolTree(Ws=nickname)

# ----
# CUSTOM STICKS
panel = Panel("C:\Users\akhaj\source\repos\CollaborativeGeometryServer\local_db\local_db.json")
file = ReadFile(File=panel, PerLineParse=False)
xy = XYPlane(Origin=Point(0, 0, 0))
button = Button()
rtf = ReadTreeFile(Json=file, ResetPlane=xy, ResetZShift=0, RESET=button)  # -> BonsaiTree, Json, Breps, Colors
writetofile = WriteToFile(Write=button, TxtContent=rtf.Json, FilePath=panel)
xy_2 = XYPlane(Origin="1000,0,-600")
addcustom = Button()
python = GhPythonScript(tree=rtf.BonsaiTree, user="base", color=ColourSwatch(SwatchColor=RGB(224, 195, 114)), planes=xy_2)  # -> out, a; inputs tree: list, color: Color, planes: list
# ---------- python: Python ----------
import Rhino
import clr

# Add reference to System.Drawing for the Color type
clr.AddReference("System.Drawing")
from System.Drawing import Color
import System

# Assuming you have access to the instance of TimberBranch
#tree = # assuming 'tree' is an existing TimberBranch instance
obj_type = tree[0].GetType()  # Get the type from an existing instance

def construct(placementPlane, user, color, obj_type):
    # Prepare the  for the constructor
    
    state = "virtual"
    # Get the constructor with the specific parameter types
    constructor_info = obj_type.GetConstructor(System.Array[System.Type]([
        Rhino.Geometry.Plane,  # Parameter type for placementPlane
        System.String,         # Parameter type for user
        Color,                 # Parameter type for color
        System.String          # Parameter type for state
    ]))
    
    # Check if the constructor is found and invoke it
    if constructor_info:
        return constructor_info.Invoke(System.Array[object]([placementPlane, user, color, state]))
#        print("Object created:", new_obj)
    else:
        return None

for pl in planes:
    obj = construct(pl, user, color, obj_type)
    
    tree.append(obj)
    

a = tree[-1]
# ---------- end python ----------
singlet = SingleTrueFilter(Trigger=nickname_2, Boolean=addcustom)
nickname_3 = SubmitSingleBranch(Ws=nickname, Branch=python.a, Submit=singlet)

c_script = CSharpScript(z=reset_selection, x=submit)  # -> out, A, B; inputs x: Boolean
# ---------- c_script: C# usings ----------
using System.Threading.Tasks;
# ---------- c_script: C# ----------
      
    counter++;
  
    if (x) counter = 0;
    
    if (counter == 3)
    {
      this.GrasshopperDocument.ScheduleSolution(1, doc => {
        
        Grasshopper.Kernel.Special.GH_ButtonObject button = 
          (Grasshopper.Kernel.Special.GH_ButtonObject) this.Component.Params.Input[0].Sources[0];
        button.ButtonDown = true;
        button.ExpireSolution(true);
        });
    }
    else if (counter == 6)
    {
      this.GrasshopperDocument.ScheduleSolution(1, doc => {
        
        Grasshopper.Kernel.Special.GH_ButtonObject button = 
          (Grasshopper.Kernel.Special.GH_ButtonObject) this.Component.Params.Input[0].Sources[0];
        button.ButtonDown = false;
        button.ExpireSolution(true);
        });
    }
# ---------- c_script: C# additional code ----------
  int counter = 10;
# ---------- end c_script ----------
or = GateOr(A=reset_selection, B=Button())
tag = TextTag(Location=previewdesign.Pt, Text=previewdesign.User, Colour=previewdesign.Color)
panel_2 = Panel(previewdesign.Pt)
preview = CustomPreview(Geometry=wires, Material=previewdesign.Color)
singlet_2 = SingleTrueFilter(Trigger=nickname_2, Boolean=submit)
mouseselection = MouseSelection(Run=Toggle(True), Branches=nickname, Reset=or, ModifyMode=Toggle(False))  # -> SelectedBranch, SecondaryBranch
toggle = BooleanToggle(True)
detbranch = DeconstructTBranch(TBranch=nickname_2)  # -> Branch_id, Placement_plane, Orientable_planes, Borders, User_name, Color, Status, Parents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
clean = CleanTree(
    RemoveNulls=True,
    RemoveInvalid=True,
    RemoveEmpty=False,
    Tree=[mouseselection.SelectedBranch, mouseselection.SecondaryBranch])
preview_2 = CustomPreview(Geometry=detbranch.Brep, Material=detbranch.Color)
lng = ListLength(List=clean)
swatch = ColourSwatch(SwatchColor=RGB(117, 255, 117))
equals = Equality(FirstNumber="1", SecondNumber=lng)  # -> Equality, Inequality
item = ListItem(List=clean, Index=0, Wrap=True)  # -> Item, Item1
lng_2 = ListLength(List=clean)
addtbranch = AddTBranch(
    Ws=nickname,
    Selection=mouseselection.SelectedBranch,
    User_name="arastoo",
    Color=swatch,
    ADD=False,
    MouseClicks=equals.Equality)  # -> Preivew, Circle, Serliazed, TBranch
equals_2 = Equality(FirstNumber="2", SecondNumber=lng_2)  # -> Equality, Inequality
panel_3 = Panel("1.1320000000000001, 0.9460000000000001, 0.6")
hp = HomePose("0.0,-1.5708,1.5708,0.0,1.5708,0.0")
computebridge = ComputeBridge(
    Run=equals_2.Equality,
    Shift_a=Slider(0.107, range=-0.45..0.45),
    Shift_b=Slider(-0.016, range=-0.45..0.45),
    Shift_ab=Slider(-0.194, range=-1..1),
    Branch_a=item.Item,
    Branch_b=item.Item1)
detbranch_2 = DeconstructTBranch(TBranch=addtbranch.TBranch)  # -> Branch_id, Placement_plane, Orientable_planes, Borders, User_name, Color, Status, Parents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

rg6_tcp = OnRobotRG6_TCP()
pdecon = Deconstruct(Point=rg6_tcp)  # -> XComponent, YComponent, ZComponent

split = TextSplit(Text=hp, Separators=",")

neg = Negative(Value=pdecon.ZComponent)
subtraction = Subtraction(A=neg, B=Slider(0, range=0..100))
deplane = DeconstructPlane(Plane=detbranch_2.Orientable_planes)  # -> Origin, XAxis, YAxis, ZAxis
amp = Amplitude(Vector=deplane.ZAxis, Amplitude=subtraction)
move = Move(Geometry=detbranch_2.Orientable_planes, Motion=amp)  # -> Geometry, Transform

number_slider = Slider(473, range=0..1000)
number_slider_2 = Slider(300, range=0..1000)
branch = TreeBranch(Tree=computebridge, Path=config, MaintainPaths=True)
xy_3 = XYPlane(Origin=Point(0, 0, 0))
python_2 = GhPythonScript(x=branch)  # -> a, b; inputs x: list
# ---------- python_2: Python ----------
__author__ = "akhaj"
__version__ = "2025.09.02"

import rhinoscriptsyntax as rs

a = x[0].placement_plane
b = x[1].placement_plane
# ---------- end python_2 ----------
singlet_3 = SingleTrueFilter(Trigger=item.Item, Boolean=submit)
rotpl = RotatePlane(plane=xy_3, X=0, Y=0, Z=Slider(180, range=0..1000), flip=False, glb=False)
nickname_4 = SubmitPreview(Ws=nickname, User="arastoo", Color=swatch, Selecitons=clean, PreviewPlanes=detbranch_2.Placement_plane)
neg_2 = Negative(Value=number_slider)
neg_3 = Negative(Value=number_slider_2)
bridge = GenrateBridge(
    Branches=nickname,
    Plane1=python_2.a,
    Plane2=python_2.b,
    Selection1=item.Item,
    Selection2=item.Item1,
    User_name="arastoo",
    Color=swatch,
    ADD=singlet_3)  # -> Preivew, Serliazed, TBranch
dom = ConstructDomain(DomainStart=neg_2, DomainEnd=number_slider)
dom_2 = ConstructDomain(DomainStart=neg_3, DomainEnd=number_slider_2)

number_slider_3 = Slider(566, range=0..1000)
neg_4 = Negative(Value=number_slider_3)
dom_3 = ConstructDomain(DomainStart=neg_4, DomainEnd=number_slider_3)
pt = Point(Point(0, 0, -300))
box = DomainBox(Base=pt, X=dom_3, Y=dom, Z=dom_2)
c_script_2 = CSharpScript(x=box, pnt=pt)  # -> out, A, B, C, D; inputs x: Box, pnt: Point3d, name: String
# ---------- c_script_2: C# ----------
    D = x.Center;
    x.Transform(Transform.Scale(Point3d.Origin, 0.001));
    pnt *= 0.001;

    var pl = Plane.WorldXY;
    //    pl.Flip();

    Quaternion q = Quaternion.Rotation(Plane.WorldXY, pl);

    List<double> pose = new List<double>();
    pose.Add(x.Center.X);
    pose.Add(x.Center.Y);
    pose.Add(x.Center.Z);
    pose.Add(q.A);
    pose.Add(q.B);
    pose.Add(q.C);
    pose.Add(q.D);

    List<double> dim = new List<double>();
    dim.Add(x.X.Length);
    dim.Add(x.Y.Length);
    dim.Add(x.Z.Length);

    var pvt = this.Component.Attributes.Pivot;
    A = string.Format("obj_at_{0}_{1}",pvt.X,pvt.Y);
    B = pose;
    C = dim;
# ---------- end c_script_2 ----------
preview_3 = CustomPreview(Geometry=box, Material=ColourSwatch(SwatchColor=RGB(164, 214, 161)))
obstacles = ObstaclesComponent(Name=c_script_2.A, Pose=c_script_2.B, Dims=c_script_2.C)

panel_4 = Panel("0.001")
list = RobotsLibrary({"UR3e", "UR5e", "UR10e", "UR16e", "UR3", "UR5", "UR10", "UR20", "UR30"}, selected="UR10e", Type=0)
ptp = PlaneToPose(Plane=move.Geometry, Scale="0.001")  # -> Origin, Quaternion, Pose
ptp_2 = PlaneToPose(Plane=move.Geometry, Scale=1)  # -> Origin, Quaternion, Pose
merge = Merge(Data1=addtbranch.TBranch, Data2=bridge.TBranch)
panel_5 = Panel(",")
c_script_3 = CSharpScript(x=list)  # -> out, A; inputs x: String
# ---------- c_script_3: C# ----------
    A = x.ToLower() + ".yml";
# ---------- end c_script_3 ----------
loadrobot = LoadRobotSystem(Name=list, Base=rotpl)
flatten = FlattenTree(Tree=merge, Path="{0}")
clean_2 = CleanTree(RemoveNulls=True, RemoveInvalid=True, RemoveEmpty=False, Tree=flatten)
split_2 = TextSplit(Text=ptp.Pose, Separators=",")
merge_2 = Merge(Data2=obstacles)

mesh = Mesh(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)
tool = CreateTool(Name="DefaultGHTool", TCP=PlaneXY(0, 0, 0), Weight=0, Mesh=mesh)  # -> Tool, TCP

panel_6 = Panel(split_2)
flatten_2 = FlattenTree(Tree=merge_2, Path="{0}")
cbcall = CuroboCall(
    URL="http://172.21.1.108:5000",
    Robot=c_script_3.A,
    Targets=ptp.Pose,
    Obstacles=flatten_2,
    Stick=clean_2,
    FromHome=from_home,
    HomePose=hp,
    Visualize=visualize)  # -> OK, Error, Poses
panel_7 = Panel(cbcall.OK)
panel_8 = Panel(cbcall.Error)
join = TextJoin(Text=cbcall.Poses, Join=",")
nickname_5 = SubmitSingleBranch(Ws=nickname, Branch=clean_2, Submit=singlet_2)
target = CreateTarget(Joints=join, Tool=tool.Tool, IsCartesian=False)
flatten_3 = FlattenTree(Tree=join, Path="{0}")
flatten_4 = FlattenTree(Tree=target, Path="{0}")
reset = Button()
trigger_3 = Trigger(Interval=100, TimerInterval=100, Target=c_script_4)
item_2 = ListItem(List=flatten_3, Index=0, Wrap=True)  # -> Item1, Item
lng_3 = ListLength(List=flatten_4)
c_script_4 = CSharpScript(max=lng_3, pnt=item_2.Item1, rst=reset, speed=Slider(10, range=0..30))  # -> out, A; inputs max: Int32, pnt: String, rst: Boolean, speed: Int32
# ---------- c_script_4: C# ----------
    i+= speed;
    if (i > max - 1)
    {
      i = max - 1;
    }
    if (cpt != pnt || rst)
    {
      i = 0;
      cpt = pnt;
    }
    A = i;
# ---------- c_script_4: C# additional code ----------
  int i = 0;
  string cpt = "";
# ---------- end c_script_4 ----------
item_3 = ListItem(List=flatten_4, Index=c_script_4.A, Wrap=True)
target_2 = CreateTarget(Joints=hp, Tool=tool.Tool, IsCartesian=False)
clean_3 = CleanTree(RemoveNulls=True, RemoveInvalid=True, RemoveEmpty=False, Tree=item_3)
c_script_5 = CSharpScript(result=cbcall.Error, color=swatch, trs=Slider(150, range=0..255), robot=ColourSwatch(SwatchColor=RGB(151, 201, 190)))  # -> out, A, B, C, D; inputs result: String, color: Color, trs: Int32, robot: Color
# ---------- c_script_5: C# ----------
    var defCol = System.Drawing.Color.Gray;

    switch (result)
    {
      case ("environment_collision"):
        A = System.Drawing.Color.Red;
        B = color;
        C = robot;
        D = System.Drawing.Color.FromArgb(100, defCol.R, defCol.G, defCol.B);
        return;
      case ("floating"):
        A = System.Drawing.Color.LightGray;
        B = color;
        C = robot;
        D = System.Drawing.Color.FromArgb(100, defCol.R, defCol.G, defCol.B);
        return;
      case ("unreachable"):
        var orange = System.Drawing.Color.Orange;
        A = System.Drawing.Color.FromArgb(trs, defCol.R, defCol.G, defCol.B);
        B = color;
        C = orange;
        D = System.Drawing.Color.FromArgb(100, defCol.R, defCol.G, defCol.B);
        return;
      default:
        A = System.Drawing.Color.FromArgb(trs, defCol.R, defCol.G, defCol.B);
        B = color;
        C = robot;
        D = System.Drawing.Color.FromArgb(100, defCol.R, defCol.G, defCol.B);
        return;
    }
# ---------- end c_script_5 ----------
program = CreateProgram(Name="DefaultProgram", RobotSystem=loadrobot, Targets=target_2, StepSize=1)  # -> Program, Code, Duration, Warnings, Errors
program_2 = CreateProgram(Name="DefaultProgram", RobotSystem=loadrobot, Targets=clean_3, StepSize=1)  # -> Program, Code, Duration, Warnings, Errors
lng_4 = ListLength(List=flatten_4)
sim = ProgramSimulation(Program=program_2.Program, Time=Slider(1, range=0..1), Normalized=True)  # -> SystemMeshes, JointRotations, Plane, Index, Time, Program, Errors
sim_2 = ProgramSimulation(Program=program.Program, Time=Slider(1, range=0..1), Normalized=True)  # -> SystemMeshes, JointRotations, Plane, Index, Time, Program, Errors
preview_4 = CustomPreview(Geometry=addtbranch.Preivew, Material=c_script_5.A)
preview_5 = CustomPreview(Geometry=addtbranch.Circle, Material=c_script_5.B)
item_4 = ListItem(List=sim.Plane, Index=0, Wrap=True)  # -> Item1, Item
preview_6 = CustomPreview(Geometry=sim_2.SystemMeshes, Material=c_script_5.D)
pln = Plane(item_4.Item1)
preview_7 = CustomPreview(Geometry=sim.SystemMeshes, Material=c_script_5.C)
