# Grasshopper definition postgres_port.gh (Grasshopper 1.0.7)
# plug-ins: MouseSelection, RemoSharp

panel = Panel("C:\Users\akhaj\source\repos\CollaborativeGeometryServer\local_db\local_db.json")
button = Button()
xy = XYPlane(Origin=Point(0, 0, 0))
file = ReadFile(File=panel, PerLineParse=False)
rtf = ReadTreeFile(Json=file, ResetPlane=xy, ResetZShift=0, RESET=button)  # -> BonsaiTree, Json, Breps, Colors
writetofile = WriteToFile(Write=button, TxtContent=rtf.Json, FilePath=panel)
serializetb = SerializeTBranch(TBranches=rtf.BonsaiTree)
nickname = PoolConnection(Url="ws://localhost:8080", Connect=Toggle(False))
button_2 = Button()
nickname_2 = PoolTree(Ws=nickname)
detbranch = DeconstructTBranch(TBranch=nickname_2)  # -> Branch_id, Placement_plane, Orientable_planes, Borders, User_name, Color, Status, Parents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
button_3 = Button()
not = GateNot(A=button_2)
singlet = SingleTrueFilter(Trigger=nickname_2, Boolean=not)
preview = CustomPreview(Geometry=detbranch.Brep, Material=detbranch.Color)
singlet_2 = SingleTrueFilter(Trigger=nickname_2, Boolean=button_2)
mouseselection = MouseSelection(Run=Toggle(True), Branches=nickname_2, Reset=singlet, ModifyMode=Toggle(False))  # -> SelectedBranch, SecondaryBranch
toggle = BooleanToggle(True)
clean = CleanTree(
    RemoveNulls=True,
    RemoveInvalid=True,
    RemoveEmpty=False,
    Tree=[mouseselection.SelectedBranch, mouseselection.SecondaryBranch])
lng = ListLength(List=clean)
swatch = ColourSwatch(SwatchColor=RGB(85, 139, 181))
equals = Equality(FirstNumber="1", SecondNumber=lng)  # -> Equality, Inequality
detbranch_2 = DeconstructTBranch(TBranch=clean)  # -> Branch_id, Placement_plane, Orientable_planes, Borders, User_name, Color, Status, Parents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
addtbranch = AddTBranch(
    Branches=nickname_2,
    Selection=mouseselection.SelectedBranch,
    User_name="arastoo2",
    Color=swatch,
    ADD=Button(),
    MouseClicks=equals.Equality)  # -> Preivew, Circle, Serliazed, TBranch
item = ListItem(List=detbranch_2.Placement_plane, Index=0, Wrap=True)  # -> Item, Item1
merge = Merge(Data1=addtbranch.Preivew, Data2=addtbranch.Circle)
preview_2 = CustomPreview(Geometry=merge, Material=swatch)
c_script = CSharpScript(
    run=equals.Inequality,
    branch_a=item.Item,
    branch_b=item.Item1,
    shift_a=Slider(-0.105, range=-0.45..0.45),
    shift_b=Slider(0.178, range=-0.45..0.45),
    shift_ab=Slider(0.55, range=-1..1))  # -> out, A; inputs run: Boolean, branch_a: Plane, branch_b: Plane, shift_a: Double, shift_b: Double, shift_ab: Double
# ---------- c_script: C# usings ----------
  using System.Threading.Tasks;
  using Rhino.Geometry.Intersect;
using System.Linq;
# ---------- c_script: C# ----------
    // Run the function
    var results = BonsaiOps.RunParallelConfigs(branch_a, branch_b, shift_ab, shift_a, shift_b);

    // Flatten to a single list of Breps
    var breps = new DataTree<object>();
    for (int i = 0; i < results.Length; i++)
    {
      var pair = results[i];
      if (pair != null)
      {
        if (pair.Item1 != null) breps.Add(pair.Item1, new GH_Path(breps.BranchCount));
        if (pair.Item2 != null) breps.Add(pair.Item2, new GH_Path(breps.BranchCount - 1));
      }
    }

    A = breps;
# ---------- c_script: C# additional code ----------
  public class BonsaiStick
  {
    public Plane PlacementPlane;
    public double Length;
    public double Width;
    public double Thickness;

    public Box Box;
    public Brep Brep;
    public Point3d Center;

    public List<Brep> Tips = new List<Brep>();
    public List<Brep> Sides = new List<Brep>();

    public BonsaiStick(Plane pl, double length = 300.0, double width = 18.0, double thickness = 18.0)
    {
      PlacementPlane = pl;
      Length = length;
      Width = width;
      Thickness = thickness;

      var xInterval = new Interval(-width * 0.5, width * 0.5);
      var yInterval = new Interval(-length * 0.5, length * 0.5);
      var zInterval = new Interval(-thickness * 0.5, thickness * 0.5);

      Box = new Box(pl, xInterval, yInterval, zInterval);
      Brep = Box.ToBrep();
      Center = pl.Origin;

      // tip faces are indices [0,2] after area-sort in the original logic
      int[] tipsIndices = new int[] { 0, 2 };
      for (int i = 0; i < 6; i++)
      {
        var sub = Brep.DuplicateSubBrep(new int[] { i });
        if (Array.IndexOf(tipsIndices, i) >= 0) Tips.Add(sub);
        else Sides.Add(sub);
      }
    }
  }

  public static class BonsaiOps
  {
    public static Brep PlaneToStick(Plane placementPlane)
    {
      double width = 18.0;
      double length = 300.0;
      double thickness = 18.0;

      var x = new Interval(-width * 0.5, width * 0.5);
      var y = new Interval(-length * 0.5, length * 0.5);
      var z = new Interval(-thickness * 0.5, thickness * 0.5);
      return new Box(placementPlane, x, y, z).ToBrep();
    }

    public static Plane StickToPlane(BonsaiStick stick)
    {
      var sorted = SortStickFaces(stick);
      var sides = GetSides(sorted);
      var tips = GetTips(sorted);
      var stickPlane = GetStickPlaneInternal(stick, sides, tips);
      var rotated = new Plane(stickPlane.Origin, stickPlane.XAxis, stickPlane.ZAxis);
      return rotated;
    }

    public static void ScaleLine(ref Line line, double factor)
    {
      var mid = line.PointAt(0.5);
      var linePlane = new Plane(mid, Plane.WorldXY.ZAxis);
      var xform = Transform.Scale(linePlane, factor, factor, factor);
      line.Transform(xform);
    }

    public static List<Tuple<BrepFace, double>> SortStickFaces(BonsaiStick stick)
    {
      var faces = stick.Brep.Faces;
      var result = new List<Tuple<BrepFace, double>>(faces.Count);

      for (int i = 0; i < faces.Count; i++)
      {
        // safer area compute: duplicate the face as brep
        Brep fbrep = faces[i].DuplicateFace(false);
        var amp = AreaMassProperties.Compute(fbrep);
        double area = (amp != null) ? amp.Area : 0.0;
        result.Add(new Tuple<BrepFace, double>(faces[i], area));
      }

      // classic sort by area (ascending)
      result.Sort((a, b) => a.Item2.CompareTo(b.Item2));
      return result;
    }

    public static List<Brep> GetSides(List<Tuple<BrepFace, double>> sortedFaces)
    {
      var list = new List<Brep>();
      for (int i = 2; i < sortedFaces.Count; i++)
      {
        var fbrep = sortedFaces[i].Item1.DuplicateFace(false);
        list.Add(fbrep);
      }
      return list;
    }

    public static List<Brep> GetTips(List<Tuple<BrepFace, double>> sortedFaces)
    {
      var list = new List<Brep>();
      for (int i = 0; i < 2 && i < sortedFaces.Count; i++)
      {
        var fbrep = sortedFaces[i].Item1.DuplicateFace(false);
        list.Add(fbrep);
      }
      return list;
    }

    public static double GetThickness(List<Brep> tips)
    {
      if (tips == null || tips.Count == 0) return 0.0;
      var amp = AreaMassProperties.Compute(tips[0]);
      return (amp != null) ? Math.Sqrt(amp.Area) : 0.0;
    }

    public static double GetLength(List<Brep> tips)
    {
      if (tips == null || tips.Count < 2) return 0.0;
      var topAmp = AreaMassProperties.Compute(tips[0]);
      var botAmp = AreaMassProperties.Compute(tips[1]);
      if (topAmp == null || botAmp == null) return 0.0;
      return topAmp.Centroid.DistanceTo(botAmp.Centroid);
    }

    public static Plane GetStickPlaneInternal(BonsaiStick stick, List<Brep> sides, List<Brep> tips)
    {
      // Follow the original rotations relative to the placement plane
      var plane = new Plane(stick.PlacementPlane);
      plane.Rotate(-Math.PI * 0.5, stick.PlacementPlane.ZAxis, stick.PlacementPlane.Origin);
      plane.Rotate(-Math.PI * 0.5, stick.PlacementPlane.XAxis, stick.PlacementPlane.Origin);
      return plane;
    }

    public static Plane GetSidePlane(List<Brep> sides, int sideId, Plane stickPlane)
    {
      if (sideId < 0 || sideId >= sides.Count) return Plane.Unset;

      Brep side = sides[sideId];
      Point3d center = BrepCenter(side);

      Vector3d xAxis = stickPlane.ZAxis;

      // Use surface normal at (mid,mid) to avoid domain edge issues
      var srf = side.Surfaces[0];
      double u = srf.Domain(0).Mid;
      double v = srf.Domain(1).Mid;
      Vector3d zAxis = srf.NormalAt(u, v);
      zAxis.Unitize();

      Vector3d yAxis = Vector3d.CrossProduct(zAxis, xAxis);
      yAxis.Unitize();

      var plane = new Plane(center, xAxis, yAxis);
      return plane;
    }

    public static Point3d BrepCenter(Brep brep)
    {
      var verts = brep.DuplicateVertices();
      if (verts == null || verts.Length == 0) return Point3d.Origin;

      Point3d sum = Point3d.Origin;
      for (int i = 0; i < verts.Length; i++) sum += verts[i];
      sum /= verts.Length;
      return sum;
    }

    public static Plane GetSharedPlane(Plane sidePlaneA, Plane sidePlaneB, double shiftAb)
    {
      Line shared;
      if (!Intersection.PlanePlane(sidePlaneA, sidePlaneB, out shared))
        return Plane.Unset;

      ScaleLine(ref shared, 100.0);
      Vector3d dir = shared.Direction;
      dir.Unitize();

      var crv = shared.ToNurbsCurve();
      crv.Domain = new Interval(0.0, 1.0);
      var origin = crv.PointAt(shiftAb);
      var sharedPlane = new Plane(origin, dir);
      return sharedPlane;
    }

    public static Curve GetSharedLine(Plane sidePlaneA, Plane sidePlaneB, double shiftAb)
    {
      Line shared;
      if (!Intersection.PlanePlane(sidePlaneA, sidePlaneB, out shared))
        return null;

      ScaleLine(ref shared, 100.0);
      var crv = shared.ToNurbsCurve();
      crv.Domain = new Interval(0.0, 1.0);
      return crv;
    }

    public static BonsaiStick CreateNewStick(
      BonsaiStick sourceStick,
      Plane stickPlane,
      Plane sidePlane,
      Plane sharedPlane,
      Curve sharedLine,
      double thickness,
      double length,
      int flip,
      double shift)
    {
      // line = intersection of sharedPlane and sidePlane
      Line line;
      if (!Intersection.PlanePlane(sharedPlane, sidePlane, out line))
        return null;

      ScaleLine(ref line, 100.0);

      // Overlap with source brep
      //      Curve[] overlaps;
      //      Point3d[] xpts;
      //      bool hit = Intersection.CurveBrep(line.ToNurbsCurve(), sourceStick.Brep, RhinoDoc.ActiveDoc.ModelAbsoluteTolerance, out overlaps, out xpts);
      //      bool hit = true;

      Point3d point = 0.5 * (line.From + line.To);
      //      if (hit && overlaps != null && overlaps.Length > 0)
      //      {
      //        var seg = overlaps[0];
      //        point = 0.5 * (seg.PointAtStart + seg.PointAtEnd);
      //      }
      //      else
      //      {
      //        point =
      //      }

      point = 0.5 * (point + sharedPlane.Origin);

      // new stick plane axes
      var vector = sharedLine.PointAtEnd - sharedLine.PointAtStart;
      vector.Unitize();
      var newStickPlane = new Plane(point, vector, sidePlane.ZAxis);

      var newStickPl = new Plane(sourceStick.PlacementPlane);
      var p2p = Transform.PlaneToPlane(stickPlane, newStickPlane);
      newStickPl.Transform(p2p);

      // Translations
      var t1 = Transform.Translation(0.5 * thickness * newStickPlane.YAxis);
      newStickPl.Transform(t1);

      var t2 = Transform.Translation(flip * 0.5 * thickness * sharedPlane.ZAxis);
      newStickPl.Transform(t2);

      var t3 = Transform.Translation(length * shift * newStickPlane.ZAxis);
      newStickPl.Transform(t3);

      // Build final stick brep
      var bs = new BonsaiStick(newStickPl, sourceStick.Length, sourceStick.Width, sourceStick.Thickness);
      return bs;
    }

    public static Tuple<double, double> AdjustP1(List<Brep> sides, int sideId, Plane sharedPlane)
    {
      if (sideId < 0 || sideId >= sides.Count)
        return new Tuple<double, double>(0.0, 0.0);

      var faceBrep = sides[sideId];
      var face = faceBrep.Faces[0];
      var edge = face.OuterLoop.To3dCurve();
      var segments = edge.DuplicateSegments();

      double minD = double.PositiveInfinity;
      double maxD = double.NegativeInfinity;

      for (int i = 0; i < segments.Length; i++)
      {
        var p = segments[i].PointAtStart;
        var cp = sharedPlane.ClosestPoint(p);
        double d = p.DistanceTo(cp);
        if (d < minD) minD = d;
        if (d > maxD) maxD = d;
      }

      return new Tuple<double, double>(minD, maxD);
    }

    public static Tuple<BonsaiStick, BonsaiStick> GenerateLink(
      BonsaiStick stickA,
      BonsaiStick stickB,
      int sideIdA,
      int sideIdB,
      double shiftAb,
      bool flipBool,
      double shiftA,
      double shiftB)
    {
      // Gather planes and measures
      var sortedA = SortStickFaces(stickA);
      var sidesA = stickA.Sides;
      var tipsA = stickA.Tips;

      var sortedB = SortStickFaces(stickB);
      var sidesB = stickB.Sides;
      var tipsB = stickB.Tips;

      double thicknessA = GetThickness(tipsA);
      double lengthA = GetLength(tipsA);
      double thicknessB = GetThickness(tipsB);
      double lengthB = GetLength(tipsB);

      var stickPlaneA = GetStickPlaneInternal(stickA, sidesA, tipsA);
      var stickPlaneB = GetStickPlaneInternal(stickB, sidesB, tipsB);

      var sidePlaneA = GetSidePlane(sidesA, sideIdA, stickPlaneA);
      var sidePlaneB = GetSidePlane(sidesB, sideIdB, stickPlaneB);

      var sharedPlane = GetSharedPlane(sidePlaneA, sidePlaneB, 0.0);
      var sharedLine = GetSharedLine(sidePlaneA, sidePlaneB, 0.0);
      if (sharedLine == null) return new Tuple<BonsaiStick, BonsaiStick>(null, null);

      // Adjust P1
      var abA = AdjustP1(sidesA, sideIdA, sharedPlane);
      var abB = AdjustP1(sidesB, sideIdB, sharedPlane);

      double minD = Math.Max(abA.Item1, abB.Item1);
      double maxD = Math.Min(abA.Item2, abB.Item2);
      double translation = shiftAb * minD + (1.0 - shiftAb) * maxD;

      var move = Transform.Translation(translation * sharedPlane.ZAxis);
      var shiftedSharedPlane = sharedPlane;
      shiftedSharedPlane.Transform(move);

      int flip = flipBool ? 1 : -1;

      var stickC = CreateNewStick(stickA, stickPlaneA, sidePlaneA, shiftedSharedPlane, sharedLine, thicknessA, lengthA, flip, shiftA);
      var stickD = CreateNewStick(stickB, stickPlaneB, sidePlaneB, shiftedSharedPlane, sharedLine, thicknessB, lengthB, -flip, shiftB);


      if (!CheckIntersections(stickA.Brep, stickB.Brep, stickC.Brep, stickD.Brep)) return new Tuple<BonsaiStick, BonsaiStick>(null, null);

      return new Tuple<BonsaiStick, BonsaiStick>(stickC, stickD);
    }

    public static bool CheckIntersections(Brep stick_a, Brep stick_b, Brep stick_c, Brep stick_d)
    {
      // Array layout:
      // [0] = c -> a (should intersect)
      // [1] = c -> b (should NOT intersect)
      // [2] = d -> b (should intersect)
      // [3] = d -> a (should NOT intersect)
      bool[] results = new bool[5];


      // Launch intersection checks in parallel
      Task[] tasks = new Task[5];

      tasks[0] = Task.Run(() => results[0] = IntersectConfirmation(stick_c, stick_a)); // should be TRUE
      tasks[1] = Task.Run(() => results[1] = !IntersectConfirmation(stick_c, stick_b)); // should be TRUE (negated)
      tasks[2] = Task.Run(() => results[2] = IntersectConfirmation(stick_d, stick_b)); // should be TRUE
      tasks[3] = Task.Run(() => results[3] = !IntersectConfirmation(stick_d, stick_a)); // should be TRUE (negated)
      tasks[4] = Task.Run(() => results[4] = IntersectConfirmation(stick_c, stick_d)); // should be TRUE

      // Wait for all tasks to complete
      Task.WaitAll(tasks);

      // Return true only if all intersection conditions are met
      bool allTrue = true;
      for (int i = 0; i < results.Length; i++)
      {
        if (!results[i])
        {
          allTrue = false;
          break;
        }
      }

      return allTrue;
    }

    // Helper local function
    private static bool IntersectConfirmation(Brep x, Brep y)
    {
      Curve[] crvs;
      Point3d[] pnts;
      bool success = Intersection.BrepBrep(x, y, 0.001, out crvs, out pnts);
      bool intersects = success && crvs != null && crvs.Length > 0;

      bool enoughIntersection = IsAreaGreaterThanThreshold(crvs);

      return intersects && enoughIntersection;
    }

    // Helper area function
    public static bool IsAreaGreaterThanThreshold(Curve[] curves)
    {
      if (curves == null || curves.Length == 0)
        return false;

      Curve crv = Curve.JoinCurves(curves, 0.001)[0];
      return Rhino.Geometry.AreaMassProperties.Compute(crv, 0.001).Area > (18.0 * 18.0);

    }





    // ==== Example parallel driver (mirrors your Python block) ====

    public static Tuple<BonsaiStick, BonsaiStick>[] RunParallelConfigs(
      Plane branchAPlacement,
      Plane branchBPlacement,
      double shiftAb,
      double shiftA,
      double shiftB)
    {
      var stickA = new BonsaiStick(branchAPlacement);
      var stickB = new BonsaiStick(branchBPlacement);

      int total = 4 * 4 * 2; // i in [0..3], j in [0..3], flip in {false,true}
      var configurations = new Tuple<BonsaiStick, BonsaiStick>[total];

      Action<int> runConfig = (idx) =>
        {
        int i = idx / 8;
        int j = (idx / 2) % 4;
        bool flip = (idx % 2) == 0;

        try
        {
          configurations[idx] = GenerateLink(stickA, stickB, i, j, shiftAb, flip, shiftA, shiftB);
        }
        catch (Exception)
        {
          configurations[idx] = null;
        }
        };

      var options = new ParallelOptions
        {
          MaxDegreeOfParallelism = Environment.ProcessorCount
          };

      Parallel.For(0, total, options, runConfig);
      return configurations;
    }

    public static Tuple<BonsaiStick, BonsaiStick>[] RunParallelConfigs(
      Plane branchAPlacement,
      Plane branchBPlacement,
      double shiftA,
      double shiftB)
    {
      // --- Static setup ---
      const int iCount = 4;
      const int jCount = 4;
      const int flipCount = 2;
      const double startAB = -2.5;
      const double endAB = 2.5;
      const double stepAB = 0.5;

      int nShiftAB = (int) Math.Round((endAB - startAB) / stepAB) + 1; // 11 values
      int total = iCount * jCount * flipCount * nShiftAB;
      var configurations = new Tuple<BonsaiStick, BonsaiStick>[total];

      // --- Precompute shifts ---
      double[] shiftABs = new double[nShiftAB];
      for (int s = 0; s < nShiftAB; s++)
        shiftABs[s] = startAB + s * stepAB;

      // Precreate sticks once
      var stickA = new BonsaiStick(branchAPlacement);
      var stickB = new BonsaiStick(branchBPlacement);

      var options = new ParallelOptions
        {
          MaxDegreeOfParallelism = Environment.ProcessorCount
          };

      // --- Chunked parallel execution ---
      int batchSize = 512; // tune depending on workload
      System.Collections.Concurrent.Partitioner.Create(0, total, batchSize)
        .AsParallel()
        .WithDegreeOfParallelism(Environment.ProcessorCount)
        .ForAll(range =>
        {
        for (int idx = range.Item1; idx < range.Item2; idx++)
        {
          // Fast integer decoding
          int remainder = idx;
          int shiftIndex = remainder / (iCount * jCount * flipCount);
          remainder -= shiftIndex * (iCount * jCount * flipCount);

          int i = remainder / (jCount * flipCount);
          remainder -= i * (jCount * flipCount);

          int j = remainder / flipCount;
          bool flip = (remainder & 1) == 0; // branchless mod 2

          double shiftAB = shiftABs[shiftIndex];

          try
          {
            configurations[idx] = GenerateLink(
              stickA, stickB,
              i, j,
              shiftAB,
              flip,
              shiftA,
              shiftB);
          }
          catch
          {
            configurations[idx] = null;
          }
        }
        });

      return configurations;
    }



  }
# ---------- end c_script ----------
nickname_3 = SubmitSingleBranch(Ws=nickname, Branch=addtbranch.TBranch, Submit=singlet_2)
branch = TreeBranch(Tree=c_script.A, Path=Slider(0, range=0..10), MaintainPaths=True)
button_4 = Button()
python = GhPythonScript(x=branch)  # -> out, a, b
# ---------- python: Python ----------
__author__ = "akhaj"
__version__ = "2025.09.02"

import rhinoscriptsyntax as rs

a = x.Brep
b = x.PlacementPlane
# ---------- end python ----------
item_2 = ListItem(List=clean, Index=0, Wrap=True)  # -> Item, Item1
item_3 = ListItem(List=python.b, Index=Slider(0, range=0..1), Wrap=True)
panel_2 = Panel(nickname_3)
item_4 = ListItem(List=python.b, Index=0, Wrap=True)  # -> Item, Item1
singlet_3 = SingleTrueFilter(Trigger=item_2.Item, Boolean=button_2)
panel_3 = Panel(item_4.Item1)
bridge = GenrateBridge(
    Branches=nickname_2,
    Plane1=item_4.Item1,
    Plane2=item_4.Item,
    Selection1=item_2.Item1,
    Selection2=item_2.Item,
    User_name="arastoo2",
    Color=swatch,
    ADD=singlet_3)  # -> Preivew, Serliazed, TBranch
nickname_4 = SubmitSingleBranch(Ws=nickname, Branch=bridge.TBranch, Submit=singlet_3)
